vi "DesktopWeb.gvi"   [LabVIEW Platform Developer Preview 0.1.0]
panel controls:
  "List Box": i32 = -1
panel indicators:
  "Chart": f64[]
  "Blade Speed": f64
  "Wind Speed": f64
  "Numeric": f64
  "Url Image": string
  "Data Grid": T1[]
types:
  T1 = cluster{"Turbine": string, "Blade Speed": f64, "Power": f64, "Sys Alarm": bool, "Wind Speed": f64, "Direction": f64, "E-Total": f64, "Op Hour": f64, "Location": string, "MB": bool}
diagram:
  while {
    Wait(time to wait=250)
    Random Number() -> (number (0 to 1)=w1)
    Add(100, w1) -> w2
    Divide(x=w2, y=4) -> w3
    $"Wind Speed" <- w3
    $Numeric <- w3
    Random Number() -> (number (0 to 1)=w4)
    Add(100, w4) -> w5
    Divide(x=w5, y=3) -> w6
    $"Blade Speed" <- w6
    Random Number() -> (number (0 to 1)=w7)
    Add(100, w7) -> w8
    Random Number() -> (number (0 to 1)=w9)
    Add(100, w9) -> w10
    Random Number() -> (number (0 to 1)=w11)
    Add(100, w11) -> w12
    Insert Into Array(inArray=f64[] [], new=w8, new=w10, new=w12, new=w12, new=w5) -> w13
    $Chart <- w13
    w14 = [{"Turbine"="BDA 1", "Location"="20, 21"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}, {"Turbine"="BDA 2", "Location"="20, 22"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}, {"Turbine"="BDA 3", "Location"="20, 23"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}, {"Turbine"="BDA 4", "Location"="20, 24"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}, {"Turbine"="BDA 5", "Location"="21, 21"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}, {"Turbine"="BDA 6", "Location"="21, 22"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}, {"Turbine"="FRD 1", "Location"="30, 34"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}, {"Turbine"="FRD 2", "Location"="30, 35"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}]
    $"Data Grid" <- w14
    stop if FALSE
  }
